# Dynamo graph Sample.dyn (Dynamo 3.5.0.8297)
# packages: Synthesize toolkit 11.7.5, DynaBIMToolbox 2.0.0

# group: MODEL SELECTION
select_the_single_door_in_the = DSModelElementSelection()  # "SELECT THE SINGLE DOOR IN THE HOST FILE"; 1 picked in the model

# group: MODEL SELECTION
select_linked_elements = Python()  # CPython3
# ---------- select_linked_elements.python (52 lines) ----------
# CPython 3 version for Dynamo
import clr

# Add Revit API references
clr.AddReference("RevitAPIUI")
from Autodesk.Revit.UI import *

clr.AddReference("RevitAPI")
from Autodesk.Revit.DB import RevitLinkInstance

clr.AddReference("RevitServices")
import RevitServices
from RevitServices.Persistence import DocumentManager

# Get current document and UI document
doc = DocumentManager.Instance.CurrentDBDocument
uidoc = DocumentManager.Instance.CurrentUIApplication.ActiveUIDocument

clr.AddReference("RevitNodes")
import Revit
clr.ImportExtensions(Revit.Elements)
clr.ImportExtensions(Revit.GeometryConversion)

# Get selection object
sel1 = uidoc.Selection

# Define object types
ot1 = Selection.ObjectType.Element
ot2 = Selection.ObjectType.LinkedElement

TaskDialog.Show("Message", "Click on the link and select the single door")

# Pick link instance
li_ref = sel1.PickObject(ot1, "Select a link instance first! (or hit ESC)")
link1 = doc.GetElement(li_ref.ElementId)

if isinstance(link1, RevitLinkInstance):
    # Pick linked elements
    el_ref = sel1.PickObjects(ot2, "Select the linked elements and press Finish.")
    linkDoc = link1.GetLinkDocument()
    
    # Extract linked element IDs
    Lel_id = [r1.LinkedElementId for r1 in el_ref]
    
    # Get transformation
    tf1 = link1.GetTotalTransform().ToCoordinateSystem(True)
    
    # Convert elements to Dynamo types, keep link1 as raw Revit API object
    # Wrap link1 in a list to prevent automatic conversion
    OUT = [linkDoc.GetElement(id1).ToDSType(True) for id1 in Lel_id], tf1, [link1]
else:
    OUT = "Failed to pick a linked instance", None, [None]
# ----------------------------------------
code_block = CodeBlock(a=select_linked_elements) { a[0][0]; }

# group: MODEL SELECTION
al_get_documents = Custom[AL.Get Documents]()  # package Synthesize toolkit; Queries all linked Revit files and retrieves their Name, LinkInstance and Document properties.

code_block_2 = CodeBlock(a=al_get_documents.VARLinkInstance) { a[0]; }

# group: DYNABIMTOOLBOX / GEOMETRYAPI / SOLIDSAPI
getAndUniteElementSolids = GeometryAPI.SolidsAPI.GetAndUniteElementSolids(element=select_the_single_door_in_the)
returnDynamoSolid = GeometryAPI.SolidsAPI.ReturnDynamoSolid(solid=getAndUniteElementSolids)
getAndUniteElementSolidsTransformed = GeometryAPI.SolidsAPI.GetAndUniteElementSolidsTransformed(element=code_block, linkInstance=code_block_2)
flatten = List.Flatten(list=getAndUniteElementSolidsTransformed)
returnDynamoSolid_2 = GeometryAPI.SolidsAPI.ReturnDynamoSolid(solid=flatten)

# group: VISUALISE DATA
code_block_3 = CodeBlock { 255; }
byARGB = Color.ByARGB(red=code_block_3)
byGeometryColor = Modifiers.GeometryColor.ByGeometryColor(geometry=returnDynamoSolid, color=byARGB, lacing=Longest)
byGeometryColor_2 = Modifiers.GeometryColor.ByGeometryColor(geometry=returnDynamoSolid_2, color=byARGB, lacing=Longest)

# group: MODEL SELECTION
select_linked_elements_2 = Python()  # CPython3
# ---------- select_linked_elements_2.python (52 lines) ----------
# CPython 3 version for Dynamo
import clr

# Add Revit API references
clr.AddReference("RevitAPIUI")
from Autodesk.Revit.UI import *

clr.AddReference("RevitAPI")
from Autodesk.Revit.DB import RevitLinkInstance

clr.AddReference("RevitServices")
import RevitServices
from RevitServices.Persistence import DocumentManager

# Get current document and UI document
doc = DocumentManager.Instance.CurrentDBDocument
uidoc = DocumentManager.Instance.CurrentUIApplication.ActiveUIDocument

clr.AddReference("RevitNodes")
import Revit
clr.ImportExtensions(Revit.Elements)
clr.ImportExtensions(Revit.GeometryConversion)

# Get selection object
sel1 = uidoc.Selection

# Define object types
ot1 = Selection.ObjectType.Element
ot2 = Selection.ObjectType.LinkedElement

TaskDialog.Show("Message", "Click on the link and select the double door")

# Pick link instance
li_ref = sel1.PickObject(ot1, "Select a link instance first! (or hit ESC)")
link1 = doc.GetElement(li_ref.ElementId)

if isinstance(link1, RevitLinkInstance):
    # Pick linked elements
    el_ref = sel1.PickObjects(ot2, "Select the linked elements and press Finish.")
    linkDoc = link1.GetLinkDocument()
    
    # Extract linked element IDs
    Lel_id = [r1.LinkedElementId for r1 in el_ref]
    
    # Get transformation
    tf1 = link1.GetTotalTransform().ToCoordinateSystem(True)
    
    # Convert elements to Dynamo types, keep link1 as raw Revit API object
    # Wrap link1 in a list to prevent automatic conversion
    OUT = [linkDoc.GetElement(id1).ToDSType(True) for id1 in Lel_id], tf1, [link1]
else:
    OUT = "Failed to pick a linked instance", None, [None]
# ----------------------------------------

code_block_4 = CodeBlock(a=select_linked_elements_2) { a[0][0]; a[1]; a[2][0]; }
watch = Watch(code_block_4.out0)

# group: DYNABIMTOOLBOX / INSPECT / ELEMENTSDATA
familyInstanceOrientation = Inspect.ElementsData.FamilyInstanceOrientation(familyInstance=watch)

# group: DYNABIMTOOLBOX / GEOMETRYAPI / SOLIDSAPI
elementOrientedBboxSolidTransformed = GeometryAPI.SolidsAPI.ElementOrientedBboxSolidTransformed(element=watch, point=familyInstanceOrientation.pt, degAngle=familyInstanceOrientation.rotation, linkInstance=code_block_2)
returnDynamoSolid_3 = GeometryAPI.SolidsAPI.ReturnDynamoSolid(solid=elementOrientedBboxSolidTransformed)

# group: MODEL SELECTION
# note: Script Name: Sample.dyn
# Packages used in this script:
# Synthesize toolkit 11.7.5
# TimeStamp : 2025/9/17 17:58
# note: Script Name: Sample.dyn
# Packages used in this script:
# Synthesize toolkit 11.7.5
# TimeStamp : 2025/9/17 17:59
select_the_double_door_in_the = DSModelElementSelection()  # "SELECT THE DOUBLE DOOR IN THE SAMPLE FILE"; 1 picked in the model

# group: GEOMETRY PROCESSING
code_block_5 = CodeBlock { 0; 750; 1500; }
byCoordinates = Point.ByCoordinates(x=code_block_5.out1, y=code_block_5.out2, z=code_block_5.out0)
byCoordinates_2 = Point.ByCoordinates(x=code_block_5.out2, y=code_block_5.out1, z=code_block_5.out2)
byStartPointEndPoint = Line.ByStartPointEndPoint(startPoint=byCoordinates, endPoint=byCoordinates_2)

# group: DYNABIMTOOLBOX / INSPECT / GEOMETRYDATA
rectangleByMinMaxPoint = Generate.Geometry.RectangleByMinMaxPoint(minPoint=byCoordinates, maxPoint=byCoordinates_2)
returnLineStartPointEndPoint = Inspect.GeometryData.ReturnLineStartPointEndPoint(line=byStartPointEndPoint)
vectorByCurve = Generate.Geometry.VectorByCurve(curve=byStartPointEndPoint)
isCurveHorizontal = Inspect.GeometryData.IsCurveHorizontal(curve=byStartPointEndPoint)

# group: VISUALISE DATA
code_block_6 = CodeBlock { 100; }
byARGB_2 = Color.ByARGB(alpha=code_block_6)
byGeometryColor_3 = Modifiers.GeometryColor.ByGeometryColor(geometry=rectangleByMinMaxPoint, color=byARGB_2, lacing=Longest)

# group: MODEL SELECTION
select_the_wall_in_the_host_file = DSModelElementByCategorySelection("OST_Walls")  # 1 picked in the model

# group: DYNABIMTOOLBOX / GEOMETRYAPI / SOLIDSAPI
getWallSolid = GeometryAPI.SolidsAPI.GetWallSolid(hostModelWall=select_the_wall_in_the_host_file)
returnDynamoSolid_4 = GeometryAPI.SolidsAPI.ReturnDynamoSolid(solid=getWallSolid)

# group: MODEL SELECTION
select_linked_elements_3 = Python()  # CPython3
# ---------- select_linked_elements_3.python (52 lines) ----------
# CPython 3 version for Dynamo
import clr

# Add Revit API references
clr.AddReference("RevitAPIUI")
from Autodesk.Revit.UI import *

clr.AddReference("RevitAPI")
from Autodesk.Revit.DB import RevitLinkInstance

clr.AddReference("RevitServices")
import RevitServices
from RevitServices.Persistence import DocumentManager

# Get current document and UI document
doc = DocumentManager.Instance.CurrentDBDocument
uidoc = DocumentManager.Instance.CurrentUIApplication.ActiveUIDocument

clr.AddReference("RevitNodes")
import Revit
clr.ImportExtensions(Revit.Elements)
clr.ImportExtensions(Revit.GeometryConversion)

# Get selection object
sel1 = uidoc.Selection

# Define object types
ot1 = Selection.ObjectType.Element
ot2 = Selection.ObjectType.LinkedElement

TaskDialog.Show("Message", "Click on the link and select the wall")

# Pick link instance
li_ref = sel1.PickObject(ot1, "Select a link instance first! (or hit ESC)")
link1 = doc.GetElement(li_ref.ElementId)

if isinstance(link1, RevitLinkInstance):
    # Pick linked elements
    el_ref = sel1.PickObjects(ot2, "Select the linked elements and press Finish.")
    linkDoc = link1.GetLinkDocument()
    
    # Extract linked element IDs
    Lel_id = [r1.LinkedElementId for r1 in el_ref]
    
    # Get transformation
    tf1 = link1.GetTotalTransform().ToCoordinateSystem(True)
    
    # Convert elements to Dynamo types, keep link1 as raw Revit API object
    # Wrap link1 in a list to prevent automatic conversion
    OUT = [linkDoc.GetElement(id1).ToDSType(True) for id1 in Lel_id], tf1, [link1]
else:
    OUT = "Failed to pick a linked instance", None, [None]
# ----------------------------------------
code_block_7 = CodeBlock(a=select_linked_elements_3) { a[0][0]; }

# group: DYNABIMTOOLBOX / GEOMETRYAPI / SOLIDSAPI
getWallSolidTransformed = GeometryAPI.SolidsAPI.GetWallSolidTransformed(linkModelWall=code_block_7, linkInstance=code_block_2)
flatten_2 = List.Flatten(list=getWallSolidTransformed)
returnDynamoSolid_5 = GeometryAPI.SolidsAPI.ReturnDynamoSolid(solid=flatten_2)
code_block_8 = CodeBlock { [600, 1200, 1800, 2400, 3000]; }
translateSolidVertically = GeometryAPI.SolidsAPI.TranslateSolidVertically(solid=flatten_2, translation=code_block_8, lacing=Longest)
returnDynamoSolid_6 = GeometryAPI.SolidsAPI.ReturnDynamoSolid(solid=translateSolidVertically)
returnSolidCentroid = GeometryAPI.SolidsAPI.ReturnSolidCentroid(solid=translateSolidVertically)

# group: VISUALISE DATA
code_block_9 = CodeBlock { 255; }
byARGB_3 = Color.ByARGB(blue=code_block_9)
byGeometryColor_4 = Modifiers.GeometryColor.ByGeometryColor(geometry=returnDynamoSolid_4, color=byARGB_3, lacing=Longest)
byGeometryColor_5 = Modifiers.GeometryColor.ByGeometryColor(geometry=returnDynamoSolid_5, color=byARGB_3, lacing=Longest)

# group: GEOMETRY PROCESSING
code_block_10 = CodeBlock { 0; 100; 200; 1100; }
byCoordinates_3 = Point.ByCoordinates(x=code_block_10.out3, y=code_block_10.out2, z=code_block_10.out0)
byCoordinates_4 = Point.ByCoordinates(x=code_block_10.out2, y=code_block_10.out3, z=code_block_10.out0)
byStartPointEndPoint_2 = Line.ByStartPointEndPoint(startPoint=byCoordinates_3, endPoint=byCoordinates_4)
code_block_11 = CodeBlock { 150; 500; }

# group: DYNABIMTOOLBOX / GEOMETRYAPI / SOLIDSAPI
revitAPIExtrusionFromCurve = GeometryAPI.SolidsAPI.RevitAPIExtrusionFromCurve(line=byStartPointEndPoint_2, width=code_block_11.out0, height=code_block_11.out1)
returnDynamoSolid_7 = GeometryAPI.SolidsAPI.ReturnDynamoSolid(solid=revitAPIExtrusionFromCurve)

# group: MODEL SELECTION
select_the_room_in_the_host_file = DSModelElementByCategorySelection("OST_Rooms")  # 1 picked in the model

# group: DYNABIMTOOLBOX / GEOMETRYAPI / SURFACESAPI
roomSurface = GeometryAPI.SurfacesAPI.RoomSurface(room=select_the_room_in_the_host_file)
code_block_12 = CodeBlock { 5; }

# group: DYNABIMTOOLBOX / GEOMETRYAPI / SOLIDSAPI
revitAPIExtrusionFromPlanarFace = GeometryAPI.SolidsAPI.RevitAPIExtrusionFromPlanarFace(face=roomSurface, height=code_block_12)
returnDynamoSolid_8 = GeometryAPI.SolidsAPI.ReturnDynamoSolid(solid=revitAPIExtrusionFromPlanarFace)

# group: VISUALISE DATA
code_block_13 = CodeBlock { 25; }
byARGB_4 = Color.ByARGB(alpha=code_block_13)
byGeometryColor_6 = Modifiers.GeometryColor.ByGeometryColor(geometry=returnDynamoSolid_8, color=byARGB_4, lacing=Longest)

# group: DYNABIMTOOLBOX / GEOMETRYAPI / BOOLEANAPI
solidsUnion = GeometryAPI.BooleanAPI.SolidsUnion(solidsList=translateSolidVertically)
returnDynamoSolid_9 = GeometryAPI.SolidsAPI.ReturnDynamoSolid(solid=solidsUnion)

# group: VISUALISE DATA
code_block_14 = CodeBlock { 50; }
byARGB_5 = Color.ByARGB(alpha=code_block_14)
byGeometryColor_7 = Modifiers.GeometryColor.ByGeometryColor(geometry=returnDynamoSolid_6, color=byARGB_5, lacing=Longest)
code_block_15 = CodeBlock { 25; }
byARGB_6 = Color.ByARGB(alpha=code_block_15)
byGeometryColor_8 = Modifiers.GeometryColor.ByGeometryColor(geometry=returnDynamoSolid_7, color=byARGB_6, lacing=Longest)
code_block_16 = CodeBlock { -2000; }
translate = Geometry.Translate(geometry=returnDynamoSolid_9, xTranslation=code_block_16)
code_block_17 = CodeBlock { 50; 255; }
byARGB_7 = Color.ByARGB(alpha=code_block_17.out0, red=code_block_17.out1)
byGeometryColor_9 = Modifiers.GeometryColor.ByGeometryColor(geometry=translate, color=byARGB_7, lacing=Longest)

# group: DYNABIMTOOLBOX / GEOMETRYAPI / BOOLEAN API
solidsIntersection = GeometryAPI.BooleanAPI.SolidsIntersection(solidA=getAndUniteElementSolids, solidB=revitAPIExtrusionFromCurve)
doSolidsIntersect = GeometryAPI.BooleanAPI.DoSolidsIntersect(solidA=getAndUniteElementSolids, solidB=revitAPIExtrusionFromCurve)

# group: DYNABIMTOOLBOX / GEOMETRYAPI / SOLIDSAPI
watch_2 = Watch(solidsIntersection.intersectionVolume)
code_block_18 = CodeBlock { [500, 1000, 1500, 2000, 2500]; }
translateSolidVertically_2 = GeometryAPI.SolidsAPI.TranslateSolidVertically(solid=solidsIntersection.solidIntersection, translation=code_block_18, lacing=Longest)
returnDynamoSolid_10 = GeometryAPI.SolidsAPI.ReturnDynamoSolid(solid=translateSolidVertically_2)

# group: VISUALISE DATA
code_block_19 = CodeBlock { 50; 255; }
byARGB_8 = Color.ByARGB(alpha=code_block_19.out0, green=code_block_19.out1)
byGeometryColor_10 = Modifiers.GeometryColor.ByGeometryColor(geometry=returnDynamoSolid_10, color=byARGB_8, lacing=Longest)

watch_3 = Watch(returnLineStartPointEndPoint.EndPoint)
watch_4 = Watch(returnLineStartPointEndPoint.StartPoint)

# group: DYNABIMTOOLBOX / INSPECT / GEOMETRYDATA
returnPointsCoordinates = Inspect.GeometryData.ReturnPointsCoordinates(point=watch_4)

watch_5 = Watch(returnPointsCoordinates.X)
watch_6 = Watch(returnPointsCoordinates.Y)
watch_7 = Watch(returnPointsCoordinates.Z)

# group: VISUALISE DATA
list_create = List.Create(item0=getWallSolid, item1=flatten_2)
flatten_3 = List.Flatten(list=list_create)
code_block_20 = CodeBlock { 10; 300; }
roomFacesSolidIntersection = GeometryAPI.BooleanAPI.RoomFacesSolidIntersection(room=select_the_room_in_the_host_file, solids=flatten_3, baseOffset=code_block_20.out0, height=code_block_20.out1)
roomSurfaceIntersectionAreas = GeometryAPI.BooleanAPI.RoomSurfaceIntersectionAreas(room=select_the_room_in_the_host_file, solids=flatten_3, baseOffset=code_block_20.out0, height=code_block_20.out1)

# group: GEOMETRY PROCESSING
coreBoundary = Room.CoreBoundary(room=select_the_room_in_the_host_file)
startPoint = Curve.StartPoint(curve=coreBoundary)
code_block_21 = CodeBlock { true; }
byPoints = PolyCurve.ByPoints(points=startPoint, connectLastToFirst=code_block_21)
byPatch = Surface.ByPatch(closedCurve=byPoints)

# group: DYNABIMTOOLBOX / INSPECT / GEOMETRYDATA
isSurfaceHorizontal = Inspect.GeometryData.IsSurfaceHorizontal(surface=byPatch)

# group: MODEL SELECTION
select_the_chair = DSModelElementByCategorySelection("OST_Furniture")  # 1 picked in the model

# group: DYNABIMTOOLBOX / INSPECT / ELEMENTSDATA
getLinkedWallHostElevation = Inspect.ElementsData.GetLinkedWallHostElevation(wall=code_block_7)
getLinkedWallHostLevelName = Inspect.ElementsData.GetLinkedWallHostLevelName(wall=code_block_7)
returnSystemTypeName = Inspect.ElementsData.ReturnSystemTypeName(element=code_block_7)

# group: DYNABIMTOOLBOX / INSPECT / GEOMETRYDATA
getPhasesInChronologicalOrder = Inspect.DocumentData.GetPhasesInChronologicalOrder()

code_block_22 = CodeBlock(a=getPhasesInChronologicalOrder) { a[0]; }

# group: DYNABIMTOOLBOX / INSPECT / ELEMENTSDATA
isElementInControlPhase = Inspect.ElementsData.IsElementInControlPhase(phasesOrdered=getPhasesInChronologicalOrder, controlPhase=code_block_22, element=select_the_chair)

# group: MODEL SELECTION
select_a_host_model_level = DSModelElementByCategorySelection("OST_Levels")  # 1 picked in the model

# group: DYNABIMTOOLBOX / INSPECT / ELEMENTSDATA
linkedDoorWindowHostLevelName = Inspect.ElementsData.LinkedDoorWindowHostLevelName(element=code_block)
linkedFamilyInstanceElevation = Inspect.ElementsData.LinkedFamilyInstanceElevation(element=code_block)

# group: MODEL SELECTION
select_phase = RevitPhases("New Construction")

# group: DYNABIMTOOLBOX / INSPECT / ELEMENTSDATA
familyInstanceFamilyName = Inspect.ElementsData.FamilyInstanceFamilyName(familyInstance=select_the_chair)
hostFamilyInstanceElevation = Inspect.ElementsData.HostFamilyInstanceElevation(element=select_the_chair)
levelElevation = Inspect.ElementsData.LevelElevation(level=select_a_host_model_level)
phaseName = Inspect.ElementsData.PhaseName(phase=select_phase)

# group: DYNABIMTOOLBOX / INSPECT / ELEMENTSDATA
roomBoundingBox = Inspect.ElementsData.RoomBoundingBox(room=select_the_room_in_the_host_file)

code_block_23 = CodeBlock { [1, 3, 8, 9, 15, -3, 25, 9]; }
reverse = List.Reverse(list=code_block_23)

# group: DYNABIMTOOLBOX / INSPECT / LISTS
indexesOfMaxValue = Inspect.Lists.IndexesOfMaxValue(inputList=code_block_23)
indexesOfMinValue = Inspect.Lists.IndexesOfMinValue(inputList=code_block_23)
listCombinatorConsistent = Inspect.Lists.ListCombinatorConsistent(listA=code_block_23, listB=reverse)

code_block_24 = CodeBlock { "Sill Height"; "Width"; }

# group: DYNABIMTOOLBOX / INSPECT / ELEMENTSDATA
familyInstanceOrientation_2 = Inspect.ElementsData.FamilyInstanceOrientation(familyInstance=select_the_double_door_in_the)
eitherOneOfTwoParametersTypeInstance = Inspect.ElementsData.EitherOneOfTwoParametersTypeInstance(element=select_the_double_door_in_the, parameterName1=code_block_24.out0, parameterName2=code_block_24.out1)
eitherOneOfTwoParametersTypeInstance_2 = Inspect.ElementsData.EitherOneOfTwoParametersTypeInstance(element=select_the_double_door_in_the, parameterName1=code_block_24.out1, parameterName2=code_block_24.out0)

# group: DYNABIMTOOLBOX / GEOMETRYAPI / ELEMENTSDATA
elementOrientedBboxSolid = GeometryAPI.SolidsAPI.ElementOrientedBboxSolid(element=select_the_double_door_in_the, point=familyInstanceOrientation_2.pt, degAngle=familyInstanceOrientation_2.rotation)
returnDynamoSolid_11 = GeometryAPI.SolidsAPI.ReturnDynamoSolid(solid=elementOrientedBboxSolid)

# group: VISUALISE DATA
code_block_25 = CodeBlock { 255; }
byARGB_9 = Color.ByARGB(green=code_block_25)
byGeometryColor_11 = Modifiers.GeometryColor.ByGeometryColor(geometry=returnDynamoSolid_3, color=byARGB_9, lacing=Longest)
byGeometryColor_12 = Modifiers.GeometryColor.ByGeometryColor(geometry=returnDynamoSolid_11, color=byARGB_9, lacing=Longest)

code_block_26 = CodeBlock { ["List A Before", "List A After", "List B Before", "List B After"]; true; false; }
code_block_27 = CodeBlock { ["A", "B", "A", "D", "E"]; }
code_block_28 = CodeBlock { "A"; "C"; }
code_block_29 = CodeBlock { [1, 3, 1, 4, 6]; }
code_block_30 = CodeBlock { 1; 0; }

# group: DYNABIMTOOLBOX / INSPECT / LISTS
replaceWithIf = Inspect.Lists.ReplaceWithIf(item=code_block_27, isEqualTo=code_block_28.out0, changeWith=code_block_28.out1, lacing=Longest)
replaceWithIf_2 = Inspect.Lists.ReplaceWithIf(item=code_block_29, isEqualTo=code_block_30.out0, changeWith=code_block_30.out1, lacing=Longest)

# group: STRING PROCESSING
code_block_31 = CodeBlock { "\n"; }
string_from_object = FromObject(object=code_block_27)
join = String.Join(separator=code_block_31, string0=string_from_object)
code_block_32 = CodeBlock(a=join) { a[0]; }
code_block_33 = CodeBlock { "\n"; }
string_from_object_2 = FromObject(object=replaceWithIf)
join_2 = String.Join(separator=code_block_33, string0=string_from_object_2)
code_block_34 = CodeBlock(a=join_2) { a[0]; }
code_block_35 = CodeBlock { "\n"; }
string_from_object_3 = FromObject(object=code_block_29)
join_3 = String.Join(separator=code_block_35, string0=string_from_object_3)
code_block_36 = CodeBlock(a=join_3) { a[0]; }
code_block_37 = CodeBlock { "\n"; }
string_from_object_4 = FromObject(object=replaceWithIf_2)
join_4 = String.Join(separator=code_block_37, string0=string_from_object_4)
code_block_38 = CodeBlock(a=join_4) { a[0]; }

list_create_2 = List.Create(item0=code_block_32, item1=code_block_34, item2=code_block_36, item3=code_block_38)

# group: DYNABIMTOOLBOX / UI / OUTPUT
taskDialogReport = UI.Output.TaskDialogReport(reportsNames=code_block_26.out0, reportsData=list_create_2, EN=code_block_26.out2)
